# Grasshopper definition triennale2.gh (Grasshopper 1.0.7)

working_curves = Curve([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])  # disabled
panel = Panel("""8
10
12
9
8
10
6
5
6
8
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""")
panel_2 = Panel("""4
5
8
10""")
mesh = Mesh(<mesh referenced from the Rhino model>)
mesh_2 = Mesh(<mesh referenced from the Rhino model>)
seq = Sequence(Notation="[N-1] + 16", Length=Slider(80, range=0..1000), Initial=Slider(40, range=0..100))
seq_2 = Sequence(Notation="[N-1] + 16", Length=Slider(80, range=0..1000), Initial=Slider(0, range=0..100))
panel_3 = Panel("""5
6
8
10
12
9
8
10
6
5
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""")
crv = Curve([<curve referenced from the Rhino model> x42])
contour = ContourEx(Shape=mesh, Plane=PlaneXY(0, 0, 0), Offsets=seq)  # -> flatten(Contours)
contour_2 = ContourEx(Shape=mesh_2, Plane=PlaneXY(0, 0, 0), Offsets=seq_2)  # -> flatten(Contours)
join = JoinCurves(Curves=contour, Preserve=False)
join_2 = JoinCurves(Curves=contour_2, Preserve=False)
contour_line = Curve(<curve referenced from the Rhino model>)
reb = RebuildCurve(Curve=crv, Degree=Slider(3, range=0..10), Count=Slider(30, range=0..100), Tangents=False)
crv_2 = Curve(reb)
mesh_3 = Mesh(<mesh referenced from the Rhino model>)
curve = GhPythonScript(
    curve=contour_line,
    tile_widths=panel_3,
    mesh=mesh_3,
    tolerance=Slider(1, range=0..10),
    tile_length=Slider(40, range=0..100))  # -> out, tiles, floor_tiles; inputs curve: Curve, tile_widths: list, mesh: Mesh; disabled
# ---------- curve: Python ----------
import Rhino.Geometry as rg

tile_inventory = [float(w) for w in tile_widths]
tiles = []
floor_tiles = []
leftover_tiles = []

current_distance = 0.0
total_length = curve.GetLength()

while current_distance < total_length - tolerance and tile_inventory:
    fitted = False
    for i, w in enumerate(tile_inventory):
        if current_distance + w <= total_length:
            success_param, param = curve.LengthParameter(current_distance)
            if not success_param:
                continue

            pt = curve.PointAt(param)
            tangent = curve.TangentAt(param)
            tangent.Unitize()

            # Get closest point on the mesh and its normal
            mesh_point = mesh.ClosestMeshPoint(pt, 10.0)  # 10.0 = max distance
            if not mesh_point:
                continue
            normal = mesh.NormalAt(mesh_point)
            normal.Unitize()

            # Construct plane: X = curve tangent, Y = "down" = tangent x normal
            x_axis = tangent
            z_axis = normal
            y_axis = rg.Vector3d.CrossProduct(z_axis, x_axis)
            y_axis.Unitize()

            # Offset origin by tile height in "down" direction so tile starts at curve
            corner_pt = pt - y_axis *tile_length  # move origin down

            # Construct plane at lower-left corner
            tile_plane = rg.Plane(corner_pt, x_axis, y_axis)

            # Now draw tile starting from curve downward
            rect = rg.Rectangle3d(tile_plane, w, tile_length)
            tiles.append(rect.ToNurbsCurve())

            current_distance += w
            tile_inventory.pop(i)
            fitted = True
            break
    if not fitted:
        break
        
    # Place remaining (unused) tiles on the floor at Z = 0
    x_offset = 0.0
    spacing = 2.0  # gap between tiles

    for w in tile_inventory:
        floor_plane = rg.Plane(rg.Point3d(x_offset, 0, 0), rg.Vector3d.XAxis, rg.Vector3d.YAxis)
        floor_rect = rg.Rectangle3d(floor_plane, w, tile_length)
        floor_tiles.append(floor_rect.ToNurbsCurve())
        x_offset += w + spacing  # increment position
# ---------- end curve ----------
mesh_4 = Mesh(<mesh referenced from the Rhino model>)
curve_2 = GhPythonScript(curves=crv_2, tile_widths=panel, mesh=mesh_4, tolerance=Slider(0.2, range=0..2), tile_length=Slider(40, range=0..100))  # -> out, tiles, floor_tiles, list_of_planes; inputs curves: list of Curve, tile_widths: list, mesh: Mesh
# ---------- curve_2: Python ----------
import Rhino.Geometry as rg
import math

# Copy and sort shared inventory
tile_inventory = [float(w) for w in tile_widths]
tiles = []
floor_tiles = []
tilt_angle_deg = 20  # or set this as a GH input
tilt_angle_rad = math.radians(tilt_angle_deg)

# Sort curves from high to low based on Z of midpoint
def curve_height(c):
    midpoint_param = c.Domain.Mid
    return c.PointAt(midpoint_param).Z

curves.sort(key=curve_height, reverse=True)  # high → low
tile_inventory.sort(reverse=True)  # big tiles first

for crv in curves:
    current_distance = 0.0
    total_length = crv.GetLength()

    while current_distance < total_length - tolerance and tile_inventory:
        fitted = False
        for i, w in enumerate(tile_inventory):
            if current_distance + w <= total_length:
                # Get curve location and tangent
                success_param, param = crv.LengthParameter(current_distance)
                if not success_param:
                    continue
                pt = crv.PointAt(param)
                tangent = crv.TangentAt(param)
                tangent.Unitize()

                # Get mesh normal at closest point
                mesh_point = mesh.ClosestMeshPoint(pt, 10.0)
                if not mesh_point:
                    continue
                normal = mesh.NormalAt(mesh_point)
                normal.Unitize()

                
                # Flip the hanging direction if it's pointing upward
                x_axis = tangent
                z_axis = normal
                y_axis = rg.Vector3d.CrossProduct(z_axis, x_axis)
                y_axis.Unitize()
                
                # Tilt Y-axis by rotating around X (tangent) axis
                y_axis.Rotate(tilt_angle_rad, x_axis)

                # Offset origin so tile hangs from curve
                origin = pt + y_axis * -tile_length
                tile_plane = rg.Plane(origin, x_axis, y_axis)

                # Create rectangle
                rect = rg.Rectangle3d(tile_plane, w, tile_length)
                tiles.append(rect.ToNurbsCurve())

                current_distance += w
                tile_inventory.pop(i)
                fitted = True
                print("Fitted")
                break
        if not fitted:
            break

# Remaining unused tiles → floor layout
x_offset = 0.0
spacing = 2.0  # spacing between floor tiles

for w in tile_inventory:
    floor_plane = rg.Plane(rg.Point3d(x_offset, 0, 0), rg.Vector3d.XAxis, rg.Vector3d.YAxis)
    floor_rect = rg.Rectangle3d(floor_plane, w, tile_length)
    floor_tiles.append(floor_rect.ToNurbsCurve())
    x_offset += w + spacing
# ---------- end curve_2 ----------
boundary = BoundarySurfaces(Edges=curve_2.tiles)
panel_4 = Panel(curve_2.tiles)
panel_5 = Panel(curve_2.list_of_planes)
