# Grasshopper definition triennale3.gh (Grasshopper 1.0.8)

working_curves = Curve([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])  # disabled
crv = Curve([<curve referenced from the Rhino model> x62])
end = EndPoints(Curve=crv)  # -> Start, End
pt = Point(end.Start)
eval = EvaluateCurve(Curve=crv, Parameter=Slider(0, range=0..0.01))  # -> Point, Tangent, Angle
pl = PlaneNormal(Origin=pt, ZAxis=eval.Tangent)
deplane = DeconstructPlane(Plane=pl)  # -> Origin, XAxis, YAxis, ZAxis
pl_2 = ConstructPlane(Origin=deplane.Origin, XAxis=deplane.ZAxis, YAxis=deplane.XAxis)
pflip = FlipPlane(Plane=pl_2, ReverseX=False, ReverseY=False, SwapAxes=True)
mesh = Mesh(<mesh referenced from the Rhino model>)
offset = OffsetCurve(Curve=crv, Distance=Slider(5, range=0..10), Plane=pflip, Corners=1)
offset_2 = OffsetCurve(Curve=crv, Distance="-5", Plane=pflip, Corners=1)
len = Length(Curve=offset_2)
firebase_widths = Data([0.1939999962, 0.1903000069, 0.19, 0.1896787262, 0.1895000076, 0.1884652328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])
len_2 = Length(Curve=offset)
seq = Sequence(Notation="[N-1] + 16", Length=Slider(80, range=0..1000), Initial=Slider(40, range=0..100))
seq_2 = Sequence(Notation="[N-1] + 16", Length=Slider(80, range=0..1000), Initial=Slider(0, range=0..100))
brep = Brep(<brep referenced from the Rhino model>)
contour = ContourEx(Shape=mesh, Plane=PlaneXY(0, 0, 0), Offsets=seq)  # -> flatten(Contours)
smaller = SmallerThan(FirstNumber=len, SecondNumber=len_2)  # -> SmallerThan, OrEqualTo
larger = LargerThan(FirstNumber=len, SecondNumber=len_2)  # -> LargerThan, OrEqualTo
contour_2 = ContourEx(Shape=mesh, Plane=PlaneXY(0, 0, 0), Offsets=seq_2)  # -> flatten(Contours)
recorded_tile_lengths = Panel(firebase_widths)
project = ProjectCurve(Curve=crv, Brep=brep, Direction=Vector(0, 0, 1))
join = JoinCurves(Curves=contour, Preserve=False)
panel = Panel(larger.LargerThan)
join_2 = JoinCurves(Curves=contour_2, Preserve=False)
cull = CullPattern(List=offset_2, CullPattern=smaller.SmallerThan)
multiplication = Multiplication(A=recorded_tile_lengths, B=Slider(100, range=0..100))
cull_2 = CullPattern(List=offset, CullPattern=larger.LargerThan)
panel_2 = Panel(multiplication)
tile = Slider(1, range=0..2)
number_slider = Slider(1, range=0..4)
weave = Weave(Pattern=[0, 1], Stream0=cull, Stream1=cull_2, NullGaps=False)
number_slider_2 = Slider(1, range=0..2)
offsetted_curves = Curve([<curve referenced from the Rhino model> x62])
mesh_2 = Mesh(<mesh referenced from the Rhino model>)
crv_2 = Curve(weave)
crv_3 = Curve([<curve referenced from the Rhino model> x62])
pull = PullCurve()
onmesh = OnMesh(Mesh=mesh_2, Strength=1)
flatten = FlattenTree(Tree=crv_2, Path="{0}")
reb = RebuildCurve(Curve=crv_3, Degree=Slider(3, range=0..10), Count=Slider(30, range=0..100), Tangents=False)
crv_4 = Curve(reb)
tile_distribution_with_intersections = GhPythonScript(
    curves=crv_4,
    tile_widths=recorded_tile_lengths,
    mesh=mesh_2,
    tolerance=number_slider_2,
    tile_height=tile,
    gap_size=number_slider)  # -> out, tiles, floor_tiles, all_tile_planes, rect_list; inputs curves: list of Curve, tile_widths: list, mesh: Mesh; disabled
# ---------- tile_distribution_with_intersections: Python ----------
import Rhino.Geometry as rg
import math
import random

# Copy and sort shared inventory
tile_inventory = [float(w) for w in tile_widths]
tiles = []
floor_tiles = [] # too many tiles
all_tile_planes = []  # list of lists: one per curve
tilt_angle_deg = 35 # or set this as a GH input
tilt_angle_rad = math.radians(tilt_angle_deg)
rect_list = []

# Sort curves from high to low based on Z of midpoint
def curve_height(c):
    midpoint_param = c.Domain.Mid
    return c.PointAt(midpoint_param).Z

curves.sort(key=curve_height, reverse=True)  # high → low
tile_inventory.sort(reverse=True)  # big tiles first

for crv in curves:
    current_distance = 0.0
    total_length = crv.GetLength()
    curve_planes = []  # center planes for this curve

    while current_distance < total_length - tolerance and tile_inventory:
        fitted = False
        for i, w in enumerate(tile_inventory):
            if current_distance + w <= total_length:
                # Get curve location and tangent
                success_param, param = crv.LengthParameter(current_distance)
                if not success_param:
                    continue
                pt = crv.PointAt(param)
                tangent = crv.TangentAt(param)
                tangent.Unitize()

                # Get mesh normal at closest point
                mesh_point = mesh.ClosestMeshPoint(pt, 10.0)
                if not mesh_point:
                    continue
                normal = mesh.NormalAt(mesh_point)
                normal.Unitize()

                # Flip the hanging direction if it's pointing upward
                z_axis = normal
                z_axis.Unitize()

                # Project the tangent vector into the mesh tangent plane
                t_dot_z = rg.Vector3d.Multiply(tangent, z_axis)
                x_axis = tangent - z_axis * t_dot_z
                if x_axis.IsTiny():
                    x_axis = rg.Vector3d(1, 0, 0)  # fallback if curve is vertical
                x_axis.Unitize()

                # Now build Y axis as orthogonal to both
                y_axis = rg.Vector3d.CrossProduct(z_axis, x_axis)
                y_axis.Unitize()

                # Apply tilt by rotating Y around X (tangent) axis
                # Get slope angle from mesh normal
                slope_angle = rg.Vector3d.VectorAngle(normal, rg.Vector3d(0, 0, 1))
                max_tilt_rad = math.radians(tilt_angle_deg)

                # Reduce tilt based on steepness
                adjusted_tilt = max_tilt_rad * (1.0 - slope_angle / math.pi)
                y_axis.Rotate(adjusted_tilt, x_axis)

                # Offset origin so tile hangs from curve
                current_length= random.uniform(30.0, 40.0)
                origin = pt + y_axis * -current_length + x_axis * -w * 0.5
                tile_plane = rg.Plane(origin, x_axis, y_axis)
                
                # Create the rectangle as a closed polyline (curve)
                rect = rg.Rectangle3d(tile_plane, w - gap_size, current_length)
                rect_polyline = rect.ToPolyline()
                rect_crv = rect_polyline.ToNurbsCurve()
                rect_list.append(rect_crv)
                # Ensure it's closed
                if not rect_crv.IsClosed:
                    continue

                # Create extrusion 
                thickness_vec = tile_plane.ZAxis * tile_height
                shingle_extr = rg.Extrusion.Create(rect_crv, -thickness_vec.Length, True)

                # Convert to Brep
                shingle_brep = shingle_extr.ToBrep()
                tiles.append(shingle_brep)
                                
                center_pt = tile_plane.Origin + x_axis * (w * 0.5) + y_axis * (current_length * 0.5)
                center_plane = rg.Plane(center_pt, x_axis, y_axis)
                curve_planes.append(center_plane)
                
                current_distance += w
                tile_inventory.pop(i)
                fitted = True
                break
        if not fitted:
            break
    all_tile_planes.append(curve_planes)

# Remaining unused tiles → floor layout
x_offset = 0.0
spacing = 2.0  # spacing between floor tiles


for w in tile_inventory:
    floor_plane = rg.Plane(rg.Point3d(x_offset, 0, 0), rg.Vector3d.XAxis, rg.Vector3d.YAxis)
    general_length= 40
    floor_rect = rg.Rectangle3d(floor_plane, w, general_length)
    floor_tiles.append(floor_rect.ToNurbsCurve())
    x_offset += w + spacing
# ---------- end tile_distribution_with_intersections ----------
tile_distribution_with_intersections_2 = GhPythonScript(curves=crv_4, tile_widths=panel_2, mesh=mesh_2, tolerance=number_slider_2, gap_size=number_slider)  # -> out, tiles, floor_tiles, all_tile_planes; inputs curves: list of Curve, tile_widths: list, mesh: Mesh
# ---------- tile_distribution_with_intersections_2: Python ----------
import Rhino.Geometry as rg
import math
import random

# ---------------- Parameters ---------------- #

tile_inventory = [float(w) for w in tile_widths]  # list of widths (cm)
tiles = []                # output shingle Breps
floor_tiles = []          # unused tiles on ground
all_tile_planes = []      # planes at tile centres for debugging/robotics

# geometric + visual params
tilt_angle_deg = 35  # maximum tilt
min_gap_base   = gap_size      # cm on flat or convex parts
max_gap_extra  = 15.0     # extra cm on tight concave parts
row_gap        = 2.0      # vertical overlap gap
tile_height    = 2.0      # shingle thickness (extrusion)

# special handling for closed, short, highly concave rows
closed_short_thresh = 180.0  # length below which closed curves are "short"
closed_extra_factor = 8.0    # multiplier on extra gap for closed-short-concave rows

# curvature thresholds for gap ramp
curv_low   = 0.005
curv_high  = 0.08

tolerance = 1e-6  # small tolerance for arc length

random.seed(42)
tilt_angle_rad = math.radians(tilt_angle_deg)

# ------------------------------------------------------------ #

def curve_height(c):
    return c.PointAt(c.Domain.Mid).Z

# sort rows & inventory
curves.sort(key=curve_height, reverse=True)
tile_inventory.sort(reverse=True)

for row_idx, crv in enumerate(curves):
    cur_d   = 0.0
    total   = crv.GetLength()
    curve_planes = []

    while cur_d < total - tolerance and tile_inventory:
        fitted = False
        for idx, w in enumerate(tile_inventory):

            # raw tile width from inventory
            adj_w = w

            # build frame at current distance
            i, param = False, None
            ok, param = crv.LengthParameter(cur_d)
            if not ok: break
            pt   = crv.PointAt(param)
            tang = crv.TangentAt(param); tang.Unitize()

            # sample curvature vector & magnitude
            curv_vec = crv.CurvatureAt(param)
            curv_val = curv_vec.Length

            # locate mesh normal
            mp   = mesh.ClosestMeshPoint(pt, 10.0)
            if not mp: continue
            normal = mesh.NormalAt(mp); normal.Unitize()

            # construct local axes
            z_ax = normal
            x_ax = tang - z_ax * rg.Vector3d.Multiply(tang, z_ax)
            if x_ax.IsTiny(): x_ax = rg.Vector3d(1,0,0)
            x_ax.Unitize()
            y_ax = rg.Vector3d.CrossProduct(z_ax, x_ax); y_ax.Unitize()

            # test concavity via triple product = (tangent × curvature) · normal
            tri = -rg.Vector3d.Multiply(rg.Vector3d.CrossProduct(tang, curv_vec), normal)
            if tri > 0.0:
                # concave inward: ramp gap between curv_low-high
                k = max(0.0, min(1.0, (curv_val - curv_low) / (curv_high - curv_low)))
                gap = min_gap_base + k * max_gap_extra
                # boost for short, closed, highly concave
                if crv.IsClosed and total < closed_short_thresh and curv_val > curv_high:
                    gap += max_gap_extra * closed_extra_factor
                # cap at tile width
                gap = min(gap, adj_w - 0.1)
            else:
                # convex or flat: base gap
                gap = min_gap_base

            # enough arc length remaining?
            if cur_d + adj_w + gap > total:
                continue

            # tilt by surface slope for hanging orientation
            slope = rg.Vector3d.VectorAngle(normal, rg.Vector3d(0,0,1))
            y_ax.Rotate(tilt_angle_rad * (1.0 - slope / math.pi), x_ax)

            # place tile rectangle
            length = random.uniform(30.0, 40.0)
            origin = pt + y_ax * (-length + row_gap) + x_ax * (-adj_w * 0.5)
            base_pl = rg.Plane(origin, x_ax, y_ax)

            # shift half gap to center
            rect_pl = rg.Plane(base_pl)
            rect_pl.Origin += x_ax * (gap * 0.5)
            rect = rg.Rectangle3d(rect_pl, adj_w, length)
            if not rect.IsValid: continue

            # extrude to Brep
            rect_crv = rect.ToPolyline().ToNurbsCurve()
            extr     = rg.Extrusion.Create(rect_crv, tile_height, True)
            if not extr: continue
            tiles.append(extr.ToBrep())

            # record center plane
            centre = base_pl.Origin + x_ax * (adj_w * 0.5) + y_ax * (length * 0.5)
            curve_planes.append(rg.Plane(centre, x_ax, y_ax))

            # advance distance & remove tile
            cur_d += adj_w + gap
            tile_inventory.pop(idx)
            fitted = True
            break

        if not fitted:
            break

    all_tile_planes.append(curve_planes)

# ---------- unused tiles on ground ---------- #
floor_x = 0.0
for w in tile_inventory:
    ground = rg.Plane(rg.Point3d(floor_x, 0, 0), rg.Vector3d.XAxis, rg.Vector3d.YAxis)
    floor_tiles.append(rg.Rectangle3d(ground, w, 40).ToNurbsCurve())
    floor_x += w + 2.0
# ---------- end tile_distribution_with_intersections_2 ----------
area = Area(Geometry=tile_distribution_with_intersections.rect_list)  # -> Area, Centroid
brep_2 = Brep(tile_distribution_with_intersections.tiles)
brep_3 = Brep(tile_distribution_with_intersections_2.tiles)
panel_3 = Panel(tile_distribution_with_intersections_2.out)
ma = MassAddition(Input=area.Area)  # -> Result, PartialResults
rec = Rectangle(tile_distribution_with_intersections.rect_list)
panel_4 = Panel(ma.Result)
bool = Boolean()
